# Grasshopper definition Wire Resistivity Tool.gh (Grasshopper 1.0.8)

cross_sectional_area_mm = Slider(61.4, range=1..100)
wire_length_m = Slider(28.7, range=0.1..100)
cross_sectional_area_mm_2 = GetNumber(cross_sectional_area_mm, AtLeast=1, AtMost=1, Maximum=1.797693135e+308, Minimum=-1.797693135e+308, TreeAccess=False)
wire_length_m_2 = GetNumber(wire_length_m, AtLeast=1, AtMost=1, Maximum=1.797693135e+308, Minimum=-1.797693135e+308, TreeAccess=False)
resistivity_of_copper = Number("0.0000000168")
expression = Expression(x=cross_sectional_area_mm_2, Expression="sqrt(x / 1000 / pi)")
expression_2 = Expression(p=resistivity_of_copper, L=wire_length_m_2, A=cross_sectional_area_mm_2, Expression="p * L / A")
Y = UnitY(Factor=1)
pt = ConstructPoint(XCoordinate=0, YCoordinate=wire_length_m_2, ZCoordinate=0)
pt_2 = ConstructPoint(XCoordinate=0, YCoordinate=0, ZCoordinate=0)
context_bake = ContextBake(ResistivityOhms=expression_2)
panel = Panel(expression_2)
ln = Line(StartPoint=pt_2, EndPoint=pt)
circle = CircleCNR(Center=pt_2, Normal=Y, Radius=expression)
extrcrv = ExtrudeAlong(Base=circle, Curve=ln)
context_bake_2 = ContextBake(WireModel=extrcrv)
